# Dynamo graph ATnodes_Fit Grids to Viewport Crop Region.dyn (Dynamo 2.3.0.5885)
# packages: @nodes 1.0.2

# note: ali.tehami@yahoo.com
# 25/11/2020
# Set Grids Extents to View Crop Region extents
# note: Building on top of discussions from this dynamo forum thread:
# https://forum.dynamobim.com/t/change-revit-grid-extents/22991/9

# group: select viewport on sheet to extend all grids to its boundaries
code_block = CodeBlock { "Grids"; }
byName = Category.ByName(name=code_block)
select_viewport_only_works_when = DSModelElementSelection()  # "Select Viewport (Only works when "Use Active View?" option is disabled)"; 1 picked in the model; graph input

use_active_view = BoolSelector(true)  # graph input
# note: to be added to future "@nodes"  package
nodes_get_viewport_s_view_and = Python(IN[0]=select_viewport_only_works_when, IN[1]=use_active_view)  # "@nodes - get viewport's view and cropbox BB"
# ---------- nodes_get_viewport_s_view_and.python (52 lines) ----------
#ali.tehami@yahoo.com
#updated on 25/11/2020

import clr
import sys
sys.path.append('C:\Program Files (x86)\IronPython 2.7\Lib')
import System
from System import Array
from System.Collections.Generic import *
clr.AddReference('ProtoGeometry')
from Autodesk.DesignScript.Geometry import *
clr.AddReference("RevitNodes")
import Revit
clr.ImportExtensions(Revit.Elements)
clr.ImportExtensions(Revit.GeometryConversion)
clr.AddReference("RevitServices")
import RevitServices
from RevitServices.Persistence import DocumentManager 
from RevitServices.Transactions import TransactionManager 

clr.AddReference("RevitAPI")
clr.AddReference("RevitAPIUI")

import Autodesk 
from Autodesk.Revit.DB import *
from Autodesk.Revit.UI import *

doc = DocumentManager.Instance.CurrentDBDocument
uiapp = DocumentManager.Instance.CurrentUIApplication 
app = uiapp.Application 
uidoc = uiapp.ActiveUIDocument


######################################

def first_Elem(x):
	if (type(x) == list):
		return UnwrapElement(x[0])
	else:
		return UnwrapElement(x)



if (IN[1]):
	view = uidoc.ActiveView

else:
	view = doc.GetElement(first_Elem(IN[0]).ViewId)

cropbox = view.CropBox.ToProtoType()

OUT = view,cropbox
# ----------------------------------------
code_block_2 = CodeBlock(a=nodes_get_viewport_s_view_and) { view = a[0]; cropbox = a[1]; }

# group (continued): select viewport on sheet to extend all grids to its boundaries
# note: @nodes v.1.0.2
all_elements_of_category_in_view = Custom[@All Elements of Category in View](category=byName, view=code_block_2.view)  # package @nodes; Gets All Element of Category in a Specific View - Default View is the ActiveView. This can be used with List.Map for Multiple Categories
watch = Watch(all_elements_of_category_in_view.elements)
minPoint = BoundingBox.MinPoint(boundingBox=code_block_2.cropbox)
X = Point.X(point=minPoint)
Y = Point.Y(point=minPoint)
byCoordinates = Point.ByCoordinates(x=X, y=Y)
maxPoint = BoundingBox.MaxPoint(boundingBox=code_block_2.cropbox)
Y_2 = Point.Y(point=maxPoint)
byCoordinates_2 = Point.ByCoordinates(x=X, y=Y_2)
X_2 = Point.X(point=maxPoint)
byCoordinates_3 = Point.ByCoordinates(x=X_2, y=Y_2)
byCoordinates_4 = Point.ByCoordinates(x=X_2, y=Y)
list_create = List.Create(item0=byCoordinates, item1=byCoordinates_2, item2=byCoordinates_3, item3=byCoordinates_4)
byCornerPoints = Rectangle.ByCornerPoints(points=list_create)
watch_2 = Watch(code_block_2.view)

code_block_3 = CodeBlock(grids=watch, cropbox=byCornerPoints, view=watch_2) { grids; cropbox; view; }

# group: generate new extent of grids
curve = Grid.Curve(grid=code_block_3.grids)
code_block_4 = CodeBlock { 1000000; }
extendEnd = Curve.ExtendEnd(curve=curve, distance=code_block_4)
extendStart = Curve.ExtendStart(curve=extendEnd, distance=code_block_4)
code_block_5 = CodeBlock(curve=curve) { curve[0]; }
startPoint = Curve.StartPoint(curve=code_block_5)
byOriginNormal = Plane.ByOriginNormal(origin=startPoint)
pullOntoPlane = Curve.PullOntoPlane(curve=code_block_3.cropbox@L1, plane=byOriginNormal, lacing=Longest)
intersectAll = Geometry.IntersectAll(geometry=extendStart@L1, others=pullOntoPlane, lacing=CrossProduct)
flatten = List.Flatten(list=intersectAll@L3)
code_block_6 = CodeBlock { 0; 1; }
getItemAtIndex = List.GetItemAtIndex(list=flatten@L2, index=code_block_6.out0)
getItemAtIndex_2 = List.GetItemAtIndex(list=flatten@L2, index=code_block_6.out1)
byStartPointEndPoint = Line.ByStartPointEndPoint(startPoint=getItemAtIndex, endPoint=getItemAtIndex_2)

# group: Extensions of start/end of grids (mm)
extend_start_mm = DoubleInput(0)  # graph input
extendStart_2 = Curve.ExtendStart(curve=byStartPointEndPoint, distance=extend_start_mm)
extend_end_mm = DoubleInput(0)  # graph input
extendEnd_2 = Curve.ExtendEnd(curve=extendStart_2, distance=extend_end_mm)

# group: Move grid new curves to the correct heights
ZAxis = Vector.ZAxis()
python_script = Python(IN[0]=code_block_3.grids, IN[1]=code_block_3.view)
# ---------- python_script.python (43 lines) ----------
import clr
clr.AddReference('ProtoGeometry')
from Autodesk.DesignScript.Geometry import *

# Import DocumentManager and TransactionManager
clr.AddReference("RevitServices")
import RevitServices
from RevitServices.Persistence import DocumentManager
from RevitServices.Transactions import TransactionManager

# Import RevitAPI
clr.AddReference("RevitAPI")
import Autodesk
from Autodesk.Revit.DB import *

clr.AddReference("RevitNodes")
import Revit
clr.ImportExtensions(Revit.GeometryConversion)


doc = DocumentManager.Instance.CurrentDBDocument
uiapp = DocumentManager.Instance.CurrentUIApplication
app = uiapp.Application


grids = UnwrapElement(IN[0])
view = UnwrapElement(IN[1])

gridCurves = []
curves = []


for g in grids:
	gridCurves.append(g.GetCurvesInView(DatumExtentType.Model, view))

for i in range(0,len(gridCurves)):
	for c in gridCurves[i]:
		start = c.GetEndPoint(0)
		end = c.GetEndPoint(1)
		curves.append(Line.CreateBound(start,end).ToProtoType())

#Assign your outputs to the OUT variable
OUT = curves
# ----------------------------------------
endPoint = Curve.EndPoint(curve=python_script)
Z = Point.Z(point=endPoint)
translate = Geometry.Translate(geometry=extendEnd_2, direction=ZAxis, distance=Z)

# group: Invert start and end point to change head position and generate bound lines
flatten_2 = List.Flatten(list=translate)
startPoint_2 = Curve.StartPoint(curve=flatten_2)
endPoint_2 = Curve.EndPoint(curve=flatten_2)
python_script_2 = Python(IN[0]=startPoint_2, IN[1]=endPoint_2)
# ---------- python_script_2.python (36 lines) ----------
import clr
clr.AddReference('ProtoGeometry')
from Autodesk.DesignScript.Geometry import *

# Import DocumentManager and TransactionManager
clr.AddReference("RevitServices")
import RevitServices
from RevitServices.Persistence import DocumentManager
from RevitServices.Transactions import TransactionManager

# Import RevitAPI
clr.AddReference("RevitAPI")
import Autodesk
from Autodesk.Revit.DB import *

clr.AddReference("RevitNodes")
import Revit
clr.ImportExtensions(Revit.GeometryConversion)


doc = DocumentManager.Instance.CurrentDBDocument
uiapp = DocumentManager.Instance.CurrentUIApplication
app = uiapp.Application


startPts = UnwrapElement(IN[0])
endPts = UnwrapElement(IN[1])
revitCurves = []

  
for i in range(0,len(startPts)):
	newLine = Line.CreateBound(startPts[i].ToXyz(),endPts[i].ToXyz())
	revitCurves.append(newLine)
    
#Assign your outputs to the OUT variable
OUT = revitCurves
# ----------------------------------------

# group: Set new extent in view
flatten_3 = List.Flatten(list=code_block_3.grids)
flatten_4 = List.Flatten(list=python_script_2)
python_script_3 = Python(IN[0]=flatten_3, IN[1]=code_block_3.view, IN[2]=flatten_4)
# ---------- python_script_3.python (45 lines) ----------
import clr
clr.AddReference("ProtoGeometry")
from Autodesk.DesignScript.Geometry import *

# Import DocumentManager and TransactionManager
clr.AddReference("RevitServices")
import RevitServices
from RevitServices.Persistence import DocumentManager
from RevitServices.Transactions import TransactionManager

# Import RevitAPI
clr.AddReference("RevitAPI")
import Autodesk
from Autodesk.Revit.DB import *

clr.AddReference("RevitNodes")
import Revit
clr.ImportExtensions(Revit.GeometryConversion)


doc = DocumentManager.Instance.CurrentDBDocument
uiapp = DocumentManager.Instance.CurrentUIApplication
app = uiapp.Application


grids = map(lambda x: UnwrapElement(x),IN[0])
view = UnwrapElement(IN[1])
crvs = map(lambda x: UnwrapElement(x),IN[2])

curves = []
curvesViews = []


TransactionManager.Instance.EnsureInTransaction(doc)

for i in range(0,len(grids)):	
	grids[i].SetCurveInView(DatumExtentType.ViewSpecific,view,crvs[i])


TransactionManager.Instance.TransactionTaskDone()


	
#Assign your outputs to the OUT variable
OUT = grids
# ----------------------------------------

reset_grids_bubbles_in_view = BoolSelector(false)  # graph input
nodes_reset_grid_bubbles_in_view = Python(IN[0]=code_block_3.view, IN[1]=python_script_3, IN[2]=reset_grids_bubbles_in_view)
# ---------- nodes_reset_grid_bubbles_in_view.python (113 lines) ----------
#ali.tehami@yahoo.com
#updated on 25/11/2020

import clr
import sys
sys.path.append('C:\Program Files (x86)\IronPython 2.7\Lib')
import System
from System import Array
from System.Collections.Generic import *
clr.AddReference('ProtoGeometry')
from Autodesk.DesignScript.Geometry import *
clr.AddReference("RevitNodes")
import Revit
clr.ImportExtensions(Revit.Elements)
clr.ImportExtensions(Revit.GeometryConversion)
clr.AddReference("RevitServices")
import RevitServices
from RevitServices.Persistence import DocumentManager 
from RevitServices.Transactions import TransactionManager 

clr.AddReference("RevitAPI")
clr.AddReference("RevitAPIUI")

import Autodesk 
from Autodesk.Revit.DB import *
from Autodesk.Revit.UI import *

doc = DocumentManager.Instance.CurrentDBDocument
uiapp = DocumentManager.Instance.CurrentUIApplication 
app = uiapp.Application 
uidoc = uiapp.ActiveUIDocument


######################################


def switchBubbles(view,a):
    end_0 = DatumEnds.End0
    end_1 = DatumEnds.End1

    if a.IsBubbleVisibleInView(end_0,view) and a.IsBubbleVisibleInView(end_1,view):
        return

    if not(a.IsBubbleVisibleInView(end_0,view)) and not(a.IsBubbleVisibleInView(end_1,view)):
        return

    if a.IsBubbleVisibleInView(end_0,view):
        a.HideBubbleInView(end_0,view)
    else:
        a.ShowBubbleInView(end_0,view)

    if a.IsBubbleVisibleInView(end_1,view):
        a.HideBubbleInView(end_1,view)
    else:
        a.ShowBubbleInView(end_1,view)

def TurnOffBubbles(view,a):
    end_0 = DatumEnds.End0
    end_1 = DatumEnds.End1

    if not(a.IsBubbleVisibleInView(end_0,view)) and not(a.IsBubbleVisibleInView(end_1,view)):
        return

    if a.IsBubbleVisibleInView(end_0,view):
        a.HideBubbleInView(end_0,view)

    if a.IsBubbleVisibleInView(end_1,view):
        a.HideBubbleInView(end_1,view)

def TurnOnBubbles(view,a):
    end_0 = DatumEnds.End0
    end_1 = DatumEnds.End1

    if a.IsBubbleVisibleInView(end_0,view) and a.IsBubbleVisibleInView(end_1,view):
        return

    if not(a.IsBubbleVisibleInView(end_0,view)):
        a.ShowBubbleInView(end_0,view)

    if not(a.IsBubbleVisibleInView(end_1,view)):
        a.ShowBubbleInView(end_1,view)

def TurnOnBubbleStart(view,a):
    end_0 = DatumEnds.End0
    end_1 = DatumEnds.End1
    if not(a.IsBubbleVisibleInView(end_0,view)) and not(a.IsBubbleVisibleInView(end_1,view)):
        a.ShowBubbleInView(end_0,view)

def ResetBubbles(view,a):
    end_0 = DatumEnds.End0
    end_1 = DatumEnds.End1
    if not a.IsBubbleVisibleInView(end_0,view):
        a.ShowBubbleInView(end_0,view)

    if a.IsBubbleVisibleInView(end_1,view):
        a.HideBubbleInView(end_1,view)

selection = map(lambda x: UnwrapElement(x),IN[1])
view = UnwrapElement(IN[0])

if (IN[2]):  
	TransactionManager.Instance.EnsureInTransaction(doc)
	
	for i in selection:
	    elem = i
	    if (elem.GetType() == Grid):
	        # switchBubbles(view,elem)
	        # TurnOffBubbles(view,elem)
	        # TurnOnBubbles(view,elem)
	        # TurnOnBubbleStart(view,elem)
	        ResetBubbles(view,elem)
	
	TransactionManager.Instance.TransactionTaskDone()
# ----------------------------------------
